# Grasshopper definition Lattices_with_Copilot_001.gh (Grasshopper 1.0.7)
# plug-ins: Hops, Kangaroo2 Components, Bifocals

number_slider = Slider(6, range=0..10)  # disabled
number_slider_2 = Slider(2, range=0..2)  # disabled
number_slider_3 = Slider(24, range=0..24)
number_slider_4 = Slider(2, range=0..10)  # disabled
number_slider_5 = Slider(7.464, range=0..10)  # disabled
pi = Pi(Factor=number_slider_2)  # disabled
pi_2 = Pi(Factor=Slider(4, range=0..4))
number_slider_6 = Slider(10, range=0..10)  # disabled
number_slider_7 = Slider(10, range=0..10)  # disabled
# lattice_trig_02
number_slider_8 = Slider(10, range=0..10)  # disabled
# lattice_trig_curves_01
number_slider_9 = Slider(10, range=0..10)  # disabled
number_slider_10 = Slider(7.4, range=0..10)  # disabled
number_slider_11 = Slider(10, range=0..10)  # disabled
number_slider_12 = Slider(10, range=0..10)  # disabled
number_slider_13 = Slider(7.785, range=0..10)  # disabled
number_slider_14 = Slider(6.72, range=0..10)  # disabled
# Creating Lattices with Copilot AI
# into Grasshopper for Rhino3D
# at www.wickersonstudios.com
# Lattices
# lattice_01
number_slider_15 = Slider(10, range=0..10)  # disabled
number_slider_16 = Slider(10, range=0..10)  # disabled
# lattice_lines_01
number_slider_17 = Slider(10, range=0..10)  # disabled
number_slider_18 = Slider(10, range=0..10)  # disabled
# lattice_trig_rotation_01
number_slider_19 = Slider(10, range=0..10)  # disabled
number_slider_20 = Slider(6.812, range=0..10)  # disabled
range = Range(Domain=number_slider_14, Steps=number_slider_4)  # disabled
range_2 = Range(Domain=number_slider_5, Steps=number_slider)  # disabled
# lattice_trig_rotation_02
range_3 = Range(Domain=pi, Steps=number_slider)  # disabled
range_4 = Range(Domain=Slider(200, range=0..200), Steps=number_slider_3)
range_5 = Range(Domain=Slider(7.464, range=0..10), Steps=number_slider_3)
range_6 = Range(Domain=pi_2, Steps=number_slider_3)
# Instructions:
# 1. Drag and drop a hops node on the canvas.
# 2. Set path to:
# http://127.0.0.1:5000/lattice_trig_01
# 3. Name and toggle  component name to :
# lattice_trig_01
lattice_trig_02 = Hops(
    Size=number_slider_8,
    Spacing=number_slider_6,
    Amplitude=number_slider_10,
    Frequency=number_slider_13,
    CacheResultsInMemory=False,
    CacheSolveResults=False,
    RemoteDefinitionLocation="http://127.0.0.1:5000/lattice_trig_02",
    RemoteSolveVersion=(0, 1, 0),
    ShowInput_Enabled=False,
    ShowInput_Path=False,
    SynchronousSolve=True)  # disabled
# Instructions:
# 1. Drag and drop a hops node on the canvas.
# 2. Set path to:
# http://127.0.0.1:5000/lattice_lines_01
# 3. Name and toggle  component name to :
# lattice_lines_01
lattice_lines_01 = Hops(
    Size=number_slider_17,
    Spacing=number_slider_16,
    CacheResultsInMemory=True,
    CacheSolveResults=True,
    RemoteDefinitionLocation="http://127.0.0.1:5000/lattice_lines_01",
    RemoteSolveVersion=(0, 1, 0),
    ShowInput_Enabled=False,
    ShowInput_Path=False,
    SynchronousSolve=True)  # disabled
# Instructions:
# 1. Drag and drop a hops node on the canvas.
# 2. Set path to:
# http://127.0.0.1:5000/lattice_trig_curves_01
# 3. Name and toggle  component name to :
# lattice_trig_curves_01
lattice_trig_curves_01 = Hops(
    Size=number_slider_9,
    Spacing=number_slider_7,
    Amplitude=number_slider_11,
    Frequency=range,
    CacheResultsInMemory=True,
    CacheSolveResults=True,
    RemoteDefinitionLocation="http://127.0.0.1:5000/lattice_trig_curves_01",
    RemoteSolveVersion=(0, 1, 0),
    ShowInput_Enabled=False,
    ShowInput_Path=False,
    SynchronousSolve=True)  # disabled
# Instructions:
# 1. Drag and drop a hops node on the canvas.
# 2. Set path to:
# http://127.0.0.1:5000/lattice_trig_rotation_01
# 3. Name and toggle  component name to :
# lattice_trig_rotation_01
lattice_trig_rotation_01 = Hops(
    Size=number_slider_19,
    Spacing=number_slider_18,
    Amplitude=number_slider_20,
    Frequency=range_2,
    Rotation=range_3,
    CacheResultsInMemory=True,
    CacheSolveResults=True,
    RemoteDefinitionLocation="http://127.0.0.1:5000/lattice_trig_rotation_01",
    RemoteSolveVersion=(0, 1, 0),
    ShowInput_Enabled=False,
    ShowInput_Path=False,
    SynchronousSolve=True)  # disabled
# Instructions:
# 1. Drag and drop a hops node on the canvas.
# 2. Set path to:
# http://127.0.0.1:5000/lattice_01
# 3. Name and toggle  component name to :
# lattice_01
lattice_01 = Hops(
    Size=number_slider_15,
    Spacing=number_slider_12,
    CacheResultsInMemory=False,
    CacheSolveResults=False,
    RemoteDefinitionLocation="http://127.0.0.1:5000/lattice_01",
    RemoteSolveVersion=(0, 1, 0),
    ShowInput_Enabled=False,
    ShowInput_Path=False,
    SynchronousSolve=True)  # disabled
# Instructions:
# 1. Drag and drop a hops node on the canvas.
# 2. Set path to:
# http://127.0.0.1:5000/lattice_trig_rotation_02
# 3. Name and toggle  component name to :
# lattice_trig_rotation_02
lattice_trig_rotation_02 = Hops(
    Size=Slider(10, range=0..10),
    Spacing=Slider(10, range=0..10),
    Amplitude=Slider(6.812, range=0..10),
    Frequency=range_5,
    Rotation=range_6,
    Step=range_4,
    CacheResultsInMemory=False,
    CacheSolveResults=False,
    RemoteDefinitionLocation="http://127.0.0.1:5000/lattice_trig_rotation_02",
    RemoteSolveVersion=(0, 1, 0),
    ShowInput_Enabled=False,
    ShowInput_Path=False,
    SynchronousSolve=True)
curve = Curve(lattice_lines_01)  # disabled
point = Point(lattice_01)  # disabled
curve_2 = Curve(lattice_trig_curves_01)  # disabled
point_2 = Point(lattice_trig_02)  # disabled
curve_3 = Curve(lattice_trig_rotation_01)  # disabled
curve_4 = Curve(lattice_trig_rotation_02)
panel = Panel(point_2)  # disabled
panel_2 = Panel(curve_2)  # disabled
panel_3 = Panel(point)  # disabled
panel_4 = Panel(curve)  # disabled
panel_5 = Panel(curve_3)  # disabled
panel_6 = Panel(curve_4)
multipipe = MultiPipe(Curves=flatten(curve_4), NodeSize=0.5, EndOffset=1, StrutSize=1, Segment=0, KinkAngle=0.6, CubeFit=0, Caps="2")
